# Grasshopper definition capsule-dream.gh (Grasshopper 1.0.8)
# Copyright: GNU Lesser General Public License Version 3
# plug-ins: RhinoCodePluginGH, semio

sep = Separator()  # -> S
# ---------- sep: C# ----------
#region Usings
using System;
using System.Linq;
using System.Collections;
using System.Collections.Generic;
using System.Drawing;
using System.IO;

using Rhino;
using Rhino.Geometry;

using Grasshopper;
using Grasshopper.Kernel;
using Grasshopper.Kernel.Data;
using Grasshopper.Kernel.Types;
#endregion

public class Script_Instance : GH_ScriptInstance
{
    private void RunScript(ref object S)
    {
        S = Path.DirectorySeparatorChar;
    }
}
# ---------- end sep ----------
dir = Directory()  # -> D
# ---------- dir: C# ----------
#region Usings
using System;
using System.Linq;
using System.Collections;
using System.Collections.Generic;
using System.Drawing;
using System.IO;

using Rhino;
using Rhino.Geometry;

using Grasshopper;
using Grasshopper.Kernel;
using Grasshopper.Kernel.Data;
using Grasshopper.Kernel.Types;
#endregion

public class Script_Instance : GH_ScriptInstance
{
    private void RunScript(ref object D)
    {
        D = Path.GetDirectoryName(this.GrasshopperDocument.FilePath);
    }
}
# ---------- end dir ----------
# ^                                    ^
#    |                                     |
# <-- Constants    Preview -->
# Parameters    External    Local -->
# <-- Meta               |
#      |                       v
#      v
par = ParentDirectory(D=dir)  # -> P; inputs D: String
# ---------- par: C# ----------
#region Usings
using System;
using System.Linq;
using System.Collections;
using System.Collections.Generic;
using System.Drawing;
using System.IO;

using Rhino;
using Rhino.Geometry;

using Grasshopper;
using Grasshopper.Kernel;
using Grasshopper.Kernel.Data;
using Grasshopper.Kernel.Types;
#endregion

public class Script_Instance : GH_ScriptInstance
{
    private void RunScript(string D, ref object P)
    {
        P = new DirectoryInfo(D).Parent;
    }
}
# ---------- end par ----------

load_kit = BooleanToggle(True)
kit = LoadKit(Uri=par, Run=load_kit)  # -> Success, Kit, LocalDirectory
kit_2 = ModelKit(Kit=kit.Kit)  # -> Kit, Valid, Name, Description, Icon, Image, Preview, Version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
trim = TrimTree(Tree=kit_2.Types, Depth=1)
trim_2 = TrimTree(Tree=kit_2.Designs, Depth=1)

typ = ModelType(Type=kit_2.Types)  # -> Type, Valid, Name, Description, Icon, Image, Variant, Unit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
ty = Type([null x45])
dn = Design([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])
mime = Mime({".stl": "model/stl", ".obj": "model/obj", ".glb": "model/gltf-binary", ".gltf": "model/gltf+json", ".3dm": "model/vnd.3dm", ".speckle": "model/vnd.speckle+json", ".png": "image/png", ".jpg": "image/jpeg", ".jpeg": "image/jpeg", ".svg": "image/svg+xml", ".pdf": "application/pdf", ".zip": "application/zip", ".json": "application/json", ".csv": "text/csv", ".txt": "text/plain"}, selected=".3dm")
qal = ModelQuality(Quality=typ.Qualities)  # -> Quality, Valid, Name, Value, Unit, Definition
variant = GetString("", AtLeast=0, AtMost=1, TreeAccess=False)
view = GetString("", AtLeast=0, AtMost=1, TreeAccess=False)
list = ValueList({"1to500", "1to200"}, selected="1to500")
# Outputs   ->
#                 |
#                 v
panel = Panel(qal.Name)

# ----
# Reuse designs
panel_2 = Panel("Nakagin Capsule Tower")
seldsn = SelectDesign(dn=dn, na=panel_2)
seldsn_2 = SelectDesign(dn=dn, na=panel_2, variant="Slanted")
seldsn_3 = SelectDesign(dn=dn, na=panel_2, variant="Dancing", view="Explosion Axonometry")
seldsn_4 = SelectDesign(dn=dn, na=panel_2, variant="Twisted")
dancing = Design(seldsn_3)
original = Design(seldsn)
slanted = Design(seldsn_2)
twisted = Design(seldsn_4)

zoom = Button()
panel_3 = Panel(qal.Definition)

energy_global_warming_potential_kgco2e_k = ValueList({"Natural Gas": 0.201, "Heating Oil": 0.216, "Electricity Non-Renewable": 0.5, "Electricity Renewable": 0}, selected="Natural Gas")  # "Energy Global Warming Potential [kgCO2e/kWh]"
energy_global_warming_potential_kgco2e_k_2 = ValueList({"Natural Gas": 0.201, "Heating Oil": 0.216, "Electricity Non-Renewable": 0.5, "Electricity Renewable": 0}, selected="Electricity Non-Renewable")  # "Energy Global Warming Potential [kgCO2e/kWh]"
energy_price_kwh = ValueList({"Natural Gas": 0.095, "Heating Oil": 0.10, "Electricity Non-Renewable": 0.25, "Electrictiy Renewable": 0.35}, selected="Natural Gas")
energy_price_kwh_2 = ValueList({"Natural Gas": 0.095, "Heating Oil": 0.10, "Electricity Non-Renewable": 0.25, "Electrictiy Renewable": 0.35}, selected="Electricity Non-Renewable")

# ----
# Orient
pln = Plane(Plane(origin=(0, 27.5, 0), x=(0, 1, 0), y=(-1, 0, 0)))
pln_2 = Plane(Plane(origin=(110, 0, 0), x=(-1, 0, 0), y=(0, -1, 0)))
pln_3 = Plane(PlaneXY(27.5, 137.5, 0))
pln_4 = Plane(Plane(origin=(137.5, 110, 0), x=(0, -1, 0), y=(1, 0, 0)))
orient = Orient(Source=PlaneXY(0, 0, 0), Target=pln)  # -> Geometry, Transform
orient_2 = Orient(Source=PlaneXY(0, 0, 0), Target=pln_3)  # -> Geometry, Transform
orient_3 = Orient(Source=PlaneXY(0, 0, 0), Target=pln_2)  # -> Geometry, Transform
orient_4 = Orient(Source=PlaneXY(0, 0, 0), Target=pln_4)  # -> Geometry, Transform
dsn = MoveDesign(dn=original, pn=orient.Transform)
dsn_2 = MoveDesign(dn=slanted, pn=orient_2.Transform)
dsn_3 = MoveDesign(dn=twisted, pn=orient_3.Transform)
dsn_4 = MoveDesign(dn=dancing, pn=orient_4.Transform)

kit_3 = ModelKit()  # -> Kit, Valid, Name, Description, Icon, Image, Preview, Version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

# ----
# Interpolate between
number_slider = Slider(0.33, range=0..1)
expression = Expression(x=number_slider, Expression="1-x")
inpdsn = InterpolateDesigns(S=dsn, T=dsn_2, t=number_slider)  # -> dn_s_u_t_2, dn_s_t_2, dn_t_s_2
inpdsn_2 = InterpolateDesigns(S=dsn, T=dsn_2, t=expression)  # -> dn_s_u_t_2, dn_s_t_2, dn_t_s_2
inpdsn_3 = InterpolateDesigns(S=dsn, T=dsn_3, t=number_slider)  # -> dn_s_u_t_2, dn_s_t_2, dn_t_s_2
inpdsn_4 = InterpolateDesigns(S=dsn, T=dsn_3, t=expression)  # -> dn_s_u_t_2, dn_s_t_2, dn_t_s_2
inpdsn_5 = InterpolateDesigns(S=dsn_2, T=dsn_4, t=number_slider)  # -> dn_s_u_t_2, dn_s_t_2, dn_t_s_2
inpdsn_6 = InterpolateDesigns(S=dsn_2, T=dsn_4, t=expression)  # -> dn_s_u_t_2, dn_s_t_2, dn_t_s_2
inpdsn_7 = InterpolateDesigns(S=dsn_3, T=dsn_4, t=number_slider)  # -> dn_s_u_t_2, dn_s_t_2, dn_t_s_2
inpdsn_8 = InterpolateDesigns(S=dsn_3, T=dsn_4, t=expression)  # -> dn_s_u_t_2, dn_s_t_2, dn_t_s_2
inpdsn_9 = InterpolateDesigns(S=dsn_2, T=dsn_3, t=number_slider)  # -> dn_s_u_t_2, dn_s_t_2, dn_t_s_2
inpdsn_10 = InterpolateDesigns(S=dsn_2, T=dsn_3, t=expression)  # -> dn_s_u_t_2, dn_s_t_2, dn_t_s_2
inpdsn_11 = InterpolateDesigns(S=dsn, T=dsn_4, t=number_slider)  # -> dn_s_u_t_2, dn_s_t_2, dn_t_s_2
inpdsn_12 = InterpolateDesigns(S=dsn, T=dsn_4, t=expression)  # -> dn_s_u_t_2, dn_s_t_2, dn_t_s_2

heating_energy_price_cent_kwh = Number(energy_price_kwh)
heating_global_warming_potential_kgco2e = Number(energy_global_warming_potential_kgco2e_k)  # "Heating Global Warming Potential [kgCO2e/kWh]"
cooling_efficiency_factor = Number(Slider(0.9, range=0.5..4))
electrictiy_global_warming_potential_kgc = Number(energy_global_warming_potential_kgco2e_k_2)  # "Electrictiy Global Warming Potential [kgCO2e/kWh]"
heating_efficiency_factor = Number(Slider(0.9, range=0.5..4))
cooling_energy_price_cent_kwh = Number(energy_price_kwh_2)
cooling_global_warming_potential_kgco2e = Number(energy_global_warming_potential_kgco2e_k_2)  # "Cooling Global Warming Potential [kgCO2e/kWh]"
electrictiy_energy_price_cent_kwh = Number(energy_price_kwh_2)

aut = ModelAuthor(Name="Ueli Saluz", Email="ueli@semio-tech.org")  # -> Author, Valid, Name, Email

concat = Concatenate(FragmentA="images/", FragmentB="capsule-dream", FragmentC=".png")

concat_2 = Concatenate(FragmentA="icons/", FragmentB="capsule-dream", FragmentC=".svg")

# ----
# Merge designs
merge = Merge(
    Data1=dsn,
    Data2=dsn_2,
    Data3=dsn_4,
    Data4=dsn_3,
    Data5=inpdsn.dn_s_u_t_2,
    Data6=inpdsn_2.dn_s_u_t_2,
    Data7=inpdsn_3.dn_s_u_t_2,
    Data8=inpdsn_4.dn_s_u_t_2,
    Data9=inpdsn_5.dn_s_u_t_2,
    Data10=inpdsn_6.dn_s_u_t_2,
    Data11=inpdsn_7.dn_s_u_t_2,
    Data12=inpdsn_8.dn_s_u_t_2,
    Data13=inpdsn_9.dn_s_u_t_2,
    Data14=inpdsn_10.dn_s_u_t_2,
    Data15=inpdsn_11.dn_s_u_t_2,
    Data16=inpdsn_12.dn_s_u_t_2)
dsns = MergeDesigns(
    dn=merge,
    na="Capsule Dream",
    description="A wild dream of capsule towers.",
    icon=concat_2,
    image=concat,
    variant=variant,
    view=view,
    authors=aut.Author)

# ----
# Do some calculations based on metadata
perfasm = PerformanceAssessment(
    dn=dsns,
    ty=ty,
    heating_energy_price_cent_kwh=heating_energy_price_cent_kwh,
    heating_efficiency_factor=heating_efficiency_factor,
    heating_global_warming_potential_kgco2e=heating_global_warming_potential_kgco2e,
    cooling_energy_price_cent_kwh=cooling_energy_price_cent_kwh,
    cooling_efficiency_factor=cooling_efficiency_factor,
    cooling_global_warming_potential_kgco2e=cooling_global_warming_potential_kgco2e,
    electrictiy_energy_price_cent_kwh=electrictiy_energy_price_cent_kwh,
    electrictiy_global_warming_potential_kgc=electrictiy_global_warming_potential_kgc)  # -> dn_4, effective_floor_area_m²_2, specific_operational_global_warming_pote_2, construction_cost_2, return_a_2, construction_global_warming_potential_kg_2, operational_cost_a_2, operational_global_warming_potential_kgc_2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
expression_2 = Expression(x=perfasm.construction_cost_2, Expression="x/1000000")
expression_3 = Expression(x=perfasm.operational_cost_a_2, Expression="x/1000000")
expression_4 = Expression(x=perfasm.maintenance_expenses_a_2, Expression="x/1000000")
expression_5 = Expression(x=perfasm.income_2, Expression="x/1000000")
expression_6 = Expression(x=perfasm.return_a_2, Expression="x/1000000")
expression_7 = Expression(x=perfasm.operational_energy_cost_a_2, Expression="x/1000000")
expression_8 = Expression(x=perfasm.construction_global_warming_potential_kg_2, Expression="x/1000")
expression_9 = Expression(x=perfasm.operational_global_warming_potential_kgc_2, Expression="x/1000")
expression_10 = Expression(x=perfasm.heating_energy_demand_kwh_a_2, Expression="x/1000")
expression_11 = Expression(x=perfasm.cooling_energy_demand_kwh_a_2, Expression="x/1000")
expression_12 = Expression(x=perfasm.technical_equipment_energy_demand_kwh_a_2, Expression="x/1000")
roundmult = RoundToMultiple(N=expression_5, M="0.05")  # -> R; inputs N: tree, M: tree
# ---------- roundmult: Python ----------
#Component Information
#--------------------------------------------------------------------------------------------
if ghenv.Component.RunCount<2:
    #General
    #--------------------------------------------------------------------------------------------
    __author__ = "YOUR NAME"
    __version__ = "2000.00.00"
    
    ghenv.Component.Name = "Round to Multiple"
    ghenv.Component.NickName = "RoundMult"
    ghenv.Component.Description = "Rounds a number to the nearest specified multiple."
    ghenv.Component.Message = "VER 1.0"
    ghenv.Component.Category = "Math"
    ghenv.Component.SubCategory = "Arithmetic"
    
     #Inputs
    #--------------------------------------------------------------------------------------------
    inputIndex=0
    
    ghenv.Component.Params.Input[inputIndex].Name = "Number"
    ghenv.Component.Params.Input[inputIndex].NickName = "N"
    ghenv.Component.Params.Input[inputIndex].Description = "Number to round."
    ghenv.Component.Params.Input[inputIndex].Optional = False
    inputIndex+=1
    
    ghenv.Component.Params.Input[inputIndex].Name = "Multiple"
    ghenv.Component.Params.Input[inputIndex].NickName = "M"
    ghenv.Component.Params.Input[inputIndex].Description = "Multiple to round to."
    ghenv.Component.Params.Input[inputIndex].Optional = False
    inputIndex+=1
    
    #Outputs
    #--------------------------------------------------------------------------------------------
    outputIndex=0
    
    ghenv.Component.Params.Output[outputIndex].Name = "Rounded"
    ghenv.Component.Params.Output[outputIndex].NickName = "R"
    ghenv.Component.Params.Output[outputIndex].Description = "Number rounded to the nearest specified multiple."
    outputIndex+=1


#Imports
#--------------------------------------------------------------------------------------------
from System import Object
from Grasshopper import DataTree
import math


#The Component function - Business logic only (e.g. working without trees)
#--------------------------------------------------------------------------------------------
"""Function that this component is computing.
    Inputs:
        number: The number to round.
        multiple: The multiple to round to.
    Output:
        rounded: The number rounded to the nearest specified multiple."""
def RoundToMultiple(number, multiple):
    rounded = math.ceil(number / multiple) * multiple
    return rounded

#Solver - Run with trees to enhance performance drastically
#--------------------------------------------------------------------------------------------
if __name__ == "__main__":
    
    #Initialize trees
    #--------------------------------------------------------------------------------------------
    RoundedTree = DataTree[Object]()
    
    #Data matching
    #--------------------------------------------------------------------------------------------
    for path in N.Paths:
        numberBranch = N.Branch(path)
        for i, number in enumerate(numberBranch):
            multiple = M.Branch(path)[i]
            rounded = RoundToMultiple(number, multiple)
            RoundedTree.Add(rounded, path)
    
     #Assign trees to output
    #--------------------------------------------------------------------------------------------
    R = RoundedTree
# ---------- end roundmult ----------
roundmult_2 = RoundToMultiple(N=expression_4, M="0.05")  # -> R; inputs N: tree, M: tree; same code as roundmult
roundmult_3 = RoundToMultiple(N=perfasm.specific_energy_demand_kwh_m²a_2, M="2.5")  # -> R; inputs N: tree, M: tree; same code as roundmult
roundmult_4 = RoundToMultiple(N=expression_7, M="0.05")  # -> R; inputs N: tree, M: tree; same code as roundmult
roundmult_5 = RoundToMultiple(N=expression_10, M=1)  # -> R; inputs N: tree, M: tree; same code as roundmult
roundmult_6 = RoundToMultiple(N=expression_11, M=1)  # -> R; inputs N: tree, M: tree; same code as roundmult
roundmult_7 = RoundToMultiple(N=expression_12, M=1)  # -> R; inputs N: tree, M: tree; same code as roundmult
roundmult_8 = RoundToMultiple(N=perfasm.effective_floor_area_m²_2, M="25")  # -> R; inputs N: tree, M: tree; same code as roundmult
roundmult_9 = RoundToMultiple(N=perfasm.specific_operational_global_warming_pote_2, M=1)  # -> R; inputs N: tree, M: tree; same code as roundmult
roundmult_10 = RoundToMultiple(N=expression_2, M="0.05")  # -> R; inputs N: tree, M: tree; same code as roundmult
roundmult_11 = RoundToMultiple(N=expression_6, M="0.05")  # -> R; inputs N: tree, M: tree; same code as roundmult
roundmult_12 = RoundToMultiple(N=expression_8, M="25")  # -> R; inputs N: tree, M: tree; same code as roundmult
roundmult_13 = RoundToMultiple(N=expression_3, M="0.05")  # -> R; inputs N: tree, M: tree; same code as roundmult
roundmult_14 = RoundToMultiple(N=expression_9, M="5")  # -> R; inputs N: tree, M: tree; same code as roundmult
effective_floor_area_m² = Number(roundmult_8)
specific_operational_global_warming_pote = Number(roundmult_9)  # "Specific Operational Global Warming Potential [kgCO2e/m²a]"
construction_cost_mio = Number(roundmult_10)
return_a = Number(roundmult_11)
construction_global_warming_potential_tc = Number(roundmult_12)  # "Construction Global Warming Potential [tCO2e]"
operational_cost_mio_a = Number(roundmult_13)
operational_global_warming_potential_tco = Number(roundmult_14)  # "Operational Global Warming Potential [tCO2e/a]"
income_mio_a = Number(roundmult)
maintenance_expenses_mio_a = Number(roundmult_2)
specific_energy_demand_kwh_m²a = Number(roundmult_3)
operational_energy_cost_a = Number(roundmult_4)
heating_energy_demand_mwh_a = Number(roundmult_5)
cooling_energy_demand_mwh_a = Number(roundmult_6)
technical_equipment_energy_demand_mwh_a = Number(roundmult_7)

shwdsn = ShowDesign(dn=perfasm.dn_4, ty=ty, mm=mime, lod=list, tags="volume")  # -> id_2, ur_2, pa_ur_2, pln_2
concat_3 = Concatenate(FragmentA=par, FragmentB=sep, FragmentC=shwdsn.pa_ur_2)
geo = LoadGeometry(path=flatten(concat_3), pln=flatten(shwdsn.pln_2), run=Toggle(False))  # -> object_4, col_2, shader_2
bbox = BoundingBox(Content=flatten(geo.object_4), Plane=PlaneXY(0, 0, 0), UnionBox=True)  # -> Box, Box_2
zoom2bb = ZoomToBoundingBox(N=["Top", "Front", "Right", "Perspective", "Parallel"], BB=bbox.Box, S=0, R=zoom)  # -> F, SBB; inputs BB: Box, R: Boolean
# ---------- zoom2bb: Python ----------
#Component Information
#--------------------------------------------------------------------------------------------
if ghenv.Component.RunCount<2:
    #General
    #--------------------------------------------------------------------------------------------
    __author__ = "Ueli Saluz"
    __version__ = "2022.05.21"
    
    ghenv.Component.Name = "ZoomToBoundingBox"
    ghenv.Component.NickName = "Zoom2BB"
    ghenv.Component.Description = "Zoom the view of a Rhino viewport to a bounding box."
    ghenv.Component.Message = "VER 1.1"
    ghenv.Component.Category = "Display"
    ghenv.Component.SubCategory = "Camera"
    
     #Inputs
    #--------------------------------------------------------------------------------------------
    inputIndex=0
    
    ghenv.Component.Params.Input[inputIndex].Name = "Name"
    ghenv.Component.Params.Input[inputIndex].NickName = "N"
    ghenv.Component.Params.Input[inputIndex].Description = "Name of the viewport"
    ghenv.Component.Params.Input[inputIndex].Optional = False
    inputIndex+=1
    
    ghenv.Component.Params.Input[inputIndex].Name = "BoundingBox"
    ghenv.Component.Params.Input[inputIndex].NickName = "BB"
    ghenv.Component.Params.Input[inputIndex].Description = ""
    ghenv.Component.Params.Input[inputIndex].Optional = False
    inputIndex+=1
    
    ghenv.Component.Params.Input[inputIndex].Name = "ScaleFactor"
    ghenv.Component.Params.Input[inputIndex].NickName = "S"
    ghenv.Component.Params.Input[inputIndex].Description = "A factor for the extension of the bounding box." \
    +"0 means 0 extension, a positive number makes the bounding box larger a negative smaller. The amount is proportional to the length."
    ghenv.Component.Params.Input[inputIndex].Optional = False
    inputIndex+=1
   
    
    ghenv.Component.Params.Input[inputIndex].Name = "Run"
    ghenv.Component.Params.Input[inputIndex].NickName = "R"
    ghenv.Component.Params.Input[inputIndex].Description = "Zoom to the given bounding box."
    ghenv.Component.Params.Input[inputIndex].Optional = False
    inputIndex+=1
    
    #Outputs
    #--------------------------------------------------------------------------------------------
    outputIndex=0
    
    ghenv.Component.Params.Output[outputIndex].Name = "Finished"
    ghenv.Component.Params.Output[outputIndex].NickName = "F"
    ghenv.Component.Params.Output[outputIndex].Description = "Sends True when finished. Just to trigger other depending components."
    outputIndex+=1
    
    ghenv.Component.Params.Output[outputIndex].Name = "ScaledBoundingBox"
    ghenv.Component.Params.Output[outputIndex].NickName = "SBB"
    ghenv.Component.Params.Output[outputIndex].Description = "The scaled bounding box."
    outputIndex+=1


#Imports
#--------------------------------------------------------------------------------------------
from Rhino import RhinoDoc
from Rhino.Geometry import Box

#Solver - Run with trees to enhance performance drastically
#--------------------------------------------------------------------------------------------
if __name__ == "__main__":
    try:
        vp = RhinoDoc.ActiveDoc.Views.Find(N, False).ActiveViewport
        if R:
            box = BB
            bb = BB.BoundingBox
            bb.Inflate(S*box.X.Length,S*box.Y.Length,S*box.Z.Length)
            vp.ZoomBoundingBox(bb)
            SBB = bb
        F = True
    except:
        pass
# ---------- end zoom2bb ----------
geo_2 = SemioGeometryPreview(geo=flatten(geo.object_4))

return_a_2 = Panel(return_a)
effective_floor_area_m²_2 = Panel(effective_floor_area_m²)
construction_cost_mio_2 = Panel(construction_cost_mio)
specific_operational_global_warming_pote_2 = Panel(specific_operational_global_warming_pote)  # "Specific Operational Global Warming Potential [kgCO2e/m²a]"

dsn_5 = SerializeDesign(Design=perfasm.dn_4)

# ----
# Save the new design
save = BooleanToggle(False)
dsn_6 = PutDesign(Design=perfasm.dn_4, Uri=par, Run=save)

txt = EncodeText(Text=dsn_5)
context_bake = ContextBake(Content=txt)

# ==== cluster SemioGeometryPreview: semio styled preview of geometry.
geo = ClusterInput()
swatch = ColourSwatch(SwatchColor=RGB(255, 255, 255))
swatch_2 = ColourSwatch(SwatchColor=RGB(0, 0, 0))
geo_2 = Geometry(flatten(geo))
dispatch = CSharpScript(D=geo_2)  # -> P, C, B, M, R
# ---------- dispatch: C# ----------
// Grasshopper Script Instance
#region Usings
using System;
using System.Linq;
using System.Collections;
using System.Collections.Generic;
using System.Drawing;

using Rhino;
using Rhino.Geometry;

using Grasshopper;
using Grasshopper.Kernel;
using Grasshopper.Kernel.Data;
using Grasshopper.Kernel.Types;
#endregion

public class Script_Instance : GH_ScriptInstance
{
    #region Notes
    /* 
      Members:
        RhinoDoc RhinoDocument
        GH_Document GrasshopperDocument
        IGH_Component Component
        int Iteration

      Methods (Virtual & overridable):
        Print(string text)
        Print(string format, params object[] args)
        Reflect(object obj)
        Reflect(object obj, string method_name)
    */
    #endregion

    private void RunScript(
	object D,
	ref object P,
	ref object C,
	ref object B,
	ref object M,
	ref object R)
    {
        if (
            D is Rhino.Geometry.Point ||
            D is PointCloud
            )
            P = D; // Point
        else if ( D is Mesh) M = D; // Mesh
        else if (
            D is Surface ||
            D is Extrusion ||
            D is SubD ||
            D is Brep
            )
            B = D; // Brep
        else R = D; // Rest
            
    }
}
# ---------- end dispatch ----------
debrep = DeconstructBrep(Brep=dispatch.B)  # -> Faces, Edges, Vertices
preview = CustomPreview(Geometry=flatten(dispatch.P), Material=swatch_2)
preview_2 = CustomPreview(Geometry=flatten(dispatch.C), Material=swatch_2)
preview_3 = CustomPreview(Geometry=flatten(debrep.Faces), Material=swatch)
preview_4 = CustomPreview(Geometry=flatten(debrep.Edges), Material=swatch_2)
preview_5 = CustomPreview(Geometry=flatten(dispatch.M), Material=swatch)

# ==== cluster ShowDesign: Show a design by flattening it and selecting only representations with the same mime, lod and tags.
ty = ClusterInput()
dn = ClusterInput()
mm = ClusterInput()
lod = ClusterInput()
tags = ClusterInput()
ty_2 = Type(ty)
mm_2 = Mime(mm)
tags_2 = Tags(tags)
dn_2 = Design(dn)
lod_2 = Lod(lod)
fltdsn = FlattenDesign(Design=dn_2, Type=ty_2)
dsn = ModelDesign(Design=fltdsn)  # -> Design, Valid, Name, Description, Icon, Image, Variant, View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
typ = ModelType(Type=ty_2)  # -> Type, Valid, Name, Description, Icon, Image, Variant, Unit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
trim = TrimTree(Tree=dsn.Pieces, Depth=1)
tstat = TreeStatistics(Tree=typ.Representations)  # -> Paths, Length, Count
pce = ModelPiece(Piece=trim)  # -> Piece, Valid, Id, TypeName, TypeVariant, Plane, ScreenPoint
expression = Expression(x=graft(pce.TypeName), y=typ.Name, Expression="x=y")
expression_2 = Expression(x=graft(pce.TypeVariant), y=typ.Variant, Expression="x=y")
and = GateAnd(A=expression, B=expression_2)
cull = CullPattern(List=ty_2, CullPattern=and)
lng = ListLength(List=ty_2)
txt = Text(cull)
series = Series(Start=0, Step=1, Count=lng)
txt_2 = Text(ty_2)
expression_3 = Expression(x=txt, y=txt_2, Expression="x=y")
trim_2 = TrimTree(Tree=series, Depth=1)
cull_2 = CullPattern(List=trim_2, CullPattern=expression_3)
trim_3 = TrimTree(Tree=cull_2, Depth=1)
item = ListItem(List=tstat.Paths, Index=trim_3, Wrap=True)
branch = TreeBranch(Tree=typ.Representations, Path=item, MaintainPaths=False)
mrg_p = MergeSeperatlyPrepend(x=branch)  # -> Mrgd; inputs x: tree
# ---------- mrg_p: Python ----------
if ghenv.Component.RunCount<2:
    __author__ = "Ueli Saluz"
    __version__ = "2020.05.28"
    
    ghenv.Component.Name = "MergeSeperatly(Prepend)"
    ghenv.Component.NickName = "Mrg(P)"
    ghenv.Component.Description = "Merge inputs seperatly on a new path. Prepend index of input parameter for distincting."
    ghenv.Component.Message = "VER 1.0"

from System import Object
from Grasshopper import DataTree
from Grasshopper.Kernel import GH_ParamAccess as Access

if __name__ == "__main__":
    Mrgd = DataTree[Object]()
    access = Access()
    
    for input in ghenv.Component.Params.Input:  #set all Inputaccess to Tree Access
        input.Access = access.tree
    
    for i,input in enumerate(ghenv.Component.Params.Input):
        for j,source in enumerate(input.Sources):
            for path in source.VolatileData.Paths:
                Mrgd.AddRange(source.VolatileData[path],path.PrependElement(i))
# ---------- end mrg_p ----------
selrep = SelectRepresentation(rp=mrg_p, mm=mm_2, lod=lod_2, tags=tags_2)  # -> rp_4, ur_2, pa_ur_2
trim_4 = TrimTree(Tree=selrep.ur_2, Depth=1)
trim_5 = TrimTree(Tree=selrep.pa_ur_2, Depth=1)
id = Id(pce.Id)
ur = Url(trim_4)
pa_ur = Url(trim_5)
pln = Plane(pce.Plane)
id_2 = ClusterOutput(id)
ur_2 = ClusterOutput(ur)
pa_ur_2 = ClusterOutput(pa_ur)
pln_2 = ClusterOutput(pln)

# ==== cluster LoadGeometry: Load local geometry from absolute file paths to planes.
path = ClusterInput()
pln = ClusterInput()
run = ClusterInput()
pln_2 = Plane(graft(pln))
path_2 = FilePath(path)
run_2 = Boolean(run)
import = ImportContent(
    FilePath=path_2,
    Name="*",
    Layer="*",
    Linetype="*",
    HatchPattern="*",
    AnnotationStyles="*",
    Materials="*",
    BlockDefinitions="*",
    Import=run_2)  # -> ModelTransform, Objects, Layers, Linetypes, HatchPatterns, AnnotationStyles, Materials, BlockDefinitions
object = ModelObject(Object=import.Objects)  # -> Object, Geometry, Name, Layer, Visibility, Display, Drafting, Render
orient = Orient(Geometry=object.Geometry, Source=PlaneXY(0, 0, 0), Target=pln_2)  # -> Geometry, Transform
object_2 = ModelObject(Object=object.Object, Geometry=orient.Geometry)  # -> Object, Geometry, Name, Layer, Visibility, Display, Drafting, Render
layer = ModelLayer(Layer=object_2.Layer)  # -> Layer, Name, Hidden, Locked, DisplayColour, Material, Linetype
display = DisplayAttributes(Display=object_2.Display)  # -> Display, DisplayColour, DisplayMode
display_colour = DisplayColour(DisplayColour=layer.DisplayColour)  # -> DisplayColour, Source, Colour
material = ModelMaterial(Material=layer.Material)  # -> Material, Name, Shader
display_colour_2 = DisplayColour(DisplayColour=display.DisplayColour)  # -> DisplayColour, Source, Colour
object_3 = ModelObject(object_2.Object)
col = Colour(display_colour.DisplayColour)
shader = Shader(material.Shader)
preview = CustomPreview(Geometry=object_3, Material=material.Shader)
object_4 = ClusterOutput(object_3)
shader_2 = ClusterOutput(shader)
col_2 = ClusterOutput(col)

# ==== cluster InterpolateDesigns: Interpolate between a source design and a target design. The target will act as a blueprint. The result is an interpolated union design and two unmodified but filtered difference design. Piece planes and connection values are linearly interpolated.
T = ClusterInput()
S = ClusterInput()
t = ClusterInput()
T_2 = Design(T)
S_2 = Design(S)
t_2 = Number(t)
dsn = NormalizeDesign(dn=T_2)
dsn_2 = NormalizeDesign(dn=S_2)
dsn_3 = ModelDesign(Design=dsn)  # -> Design, Valid, Name, Description, Icon, Image, Variant, View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
dsn_4 = ModelDesign(Design=dsn_2)  # -> Design, Valid, Name, Description, Icon, Image, Variant, View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
trim = TrimTree(Tree=dsn_4.Pieces, Depth=1)
trim_2 = TrimTree(Tree=dsn_4.Connections, Depth=1)
trim_3 = TrimTree(Tree=dsn_3.Connections, Depth=1)
trim_4 = TrimTree(Tree=dsn_3.Pieces, Depth=1)
con = ModelConnection(Connection=trim_3)  # -> Connection, Valid, ConnectedPieceId, ConnectedPieceTypePortId, ConnectingPieceId, ConnectingPieceTypePortId, Rotation, Tilt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
pce = ModelPiece(Piece=trim_4)  # -> Piece, Valid, Id, TypeName, TypeVariant, Plane, DiagramPoint
con_2 = ModelConnection(Connection=trim_2)  # -> Connection, Valid, ConnectedPieceId, ConnectedPieceTypePortId, ConnectingPieceId, ConnectingPieceTypePortId, Rotation, Tilt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
pce_2 = ModelPiece(Piece=trim)  # -> Piece, Valid, Id, TypeName, TypeVariant, Plane, DiagramPoint
intersection = SetIntersection(SetA=pce_2.Id, SetB=pce.Id)
difference = SetDifference(SetA=pce.Id, SetB=pce_2.Id)
difference_2 = SetDifference(SetA=pce_2.Id, SetB=pce.Id)
selcon = SelectConnection(co=trim_3, cdpc=graft(con_2.ConnectedPieceId), cgpc=graft(con_2.ConnectingPieceId))
selcon_2 = SelectConnection(co=trim_2, cdpc=graft(con.ConnectedPieceId), cgpc=graft(con.ConnectingPieceId))
selpce = SelectPiece(pc=pce.Piece, id=graft(intersection))
selpce_2 = SelectPiece(pc=pce.Piece, id=graft(difference))
selpce_3 = SelectPiece(pc=pce_2.Piece, id=graft(difference_2))
selpce_4 = SelectPiece(pc=pce_2.Piece, id=graft(intersection))
trim_5 = TrimTree(Tree=selcon, Depth=1)
trim_6 = TrimTree(Tree=selcon_2, Depth=1)
trim_7 = TrimTree(Tree=selpce_2, Depth=1)
trim_8 = TrimTree(Tree=selpce, Depth=1)
trim_9 = TrimTree(Tree=selpce_4, Depth=1)
trim_10 = TrimTree(Tree=selpce_3, Depth=1)
con_3 = ModelConnection(Connection=trim_6)  # -> Connection, Valid, ConnectedPieceId, ConnectedPieceTypePortId, ConnectingPieceId, ConnectingPieceTypePortId, Rotation, Tilt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
con_4 = ModelConnection(Connection=trim_5)  # -> Connection, Valid, ConnectedPieceId, ConnectedPieceTypePortId, ConnectingPieceId, ConnectingPieceTypePortId, Rotation, Tilt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
expression = Expression(x=t_2, Expression="1-x")
pce_3 = ModelPiece(Piece=trim_9)  # -> Piece, Valid, Id, TypeName, TypeVariant, Plane, DiagramPoint
pce_4 = ModelPiece(Piece=trim_8)  # -> Piece, Valid, Id, TypeName, TypeVariant, Plane, DiagramPoint
merge = Merge(Data1=expression, Data2=t_2)
expression_2 = Expression(x=con_3.Rotation, y=con_4.Rotation, Expression="If(Abs(x-y)≤180,y,-(360-y))")
expression_3 = Expression(x=con_3.Tilt, y=con_4.Tilt, Expression="If(Abs(x-y)≤180,y,-(360-y))")
merge_2 = Merge(Data1=graft(pce_3.Plane), Data2=graft(pce_4.Plane))
concat = Concatenate(FragmentA=dsn_3.Name, FragmentE=",", FragmentF=dsn_3.Variant)
concat_2 = Concatenate(FragmentA=dsn_4.Name, FragmentE=",", FragmentF=dsn_4.Variant)
avgpl = AveragePlane(Pl=merge_2, M=merge)  # -> AvPl; inputs Pl: list of Plane, M: list of Double
# ---------- avgpl: C# usings ----------
using System.Linq;
# ---------- avgpl: C# ----------
    //Author: Ueli Saluz
    //Last modified: 29.05.2020
    //Contact: usaluz@outlook.de

    if (Component.RunCount < 2)
    {
      Component.Name = "AveragePlane";
      Component.NickName = "AvgPl";
      Component.Description = "Get the average plane from a set of planes. Provide multiplier to weight some planes more.";

      Component.Params.Input[0].Name = "Planes";
      Component.Params.Input[0].Description = "Planes to take average from.";
      Component.Params.Input[1].Name = "weights";
      Component.Params.Input[1].Description = "weights act like weights towards a plane.";

      Component.Params.Output[0].Name = "AveragePlane";
      Component.Params.Output[0].Description = "Resulting average plane.";

      Component.Message = "VER 1.0";
    }
    AvPl = GetAveragePlane(Pl.ToArray(), M.ToArray());
# ---------- avgpl: C# additional code ----------
  /// <summary>
  /// Gets the average plane from a set of of planes. Each plane can have a weight.
  /// </summary>
  /// <param name="planes"></param>
  /// <param name="weights"></param>
  /// <returns>Average plane under consideration of weights</returns>
  public Plane GetAveragePlane(Plane[] planes, double[] weights)
  {
    //If there are less weights than planes then the weight of 1 is assumed.
    if (weights.Length < planes.Length)
      weights = weights.Concat(Enumerable.Repeat(1d, planes.Length - weights.Length)).ToArray();
    //If there are more weights than planes then the last ones will be ignored.
    else if (weights.Length > planes.Length)
      weights = weights.Take(planes.Length).ToArray();

    if (weights.Sum() == 0)
      weights = Enumerable.Repeat(1d, planes.Length).ToArray();

    var sum = weights.Sum();
    weights = weights.Select(x => x / sum).ToArray();

    var origins = planes.Select(x => x.Origin).ToArray();
    var xAxes = planes.Select(x => x.XAxis).ToArray();
    var yAxes = planes.Select(x => x.YAxis).ToArray();

    for (int i = 0; i < planes.Length; i++)
    {
      origins[i].Transform(new Transform(weights[i]));
      xAxes[i].Transform(new Transform(weights[i]));
      yAxes[i].Transform(new Transform(weights[i]));
    }

    return new Plane(origins.Aggregate((a,b) => a + b), xAxes.Aggregate((a,b) => a + b), yAxes.Aggregate((a,b) => a + b));
  }
# ---------- end avgpl ----------
concat_3 = Concatenate(FragmentA=concat, FragmentB="(", FragmentD=")")
concat_4 = Concatenate(FragmentD=")")
expression_4 = Expression(x=t_2, Expression="x≥0.5")
c_script = CSharpScript(x=avgpl)  # -> a; inputs x: Plane
# ---------- c_script: C# ----------
// Grasshopper Script Instance
#region Usings
using System;
using System.Linq;
using System.Collections;
using System.Collections.Generic;
using System.Drawing;

using Rhino;
using Rhino.Geometry;

using Grasshopper;
using Grasshopper.Kernel;
using Grasshopper.Kernel.Data;
using Grasshopper.Kernel.Types;
#endregion

public class Script_Instance : GH_ScriptInstance
{
    #region Notes
    /* 
      Members:
        RhinoDoc RhinoDocument
        GH_Document GrasshopperDocument
        IGH_Component Component
        int Iteration

      Methods (Virtual & overridable):
        Print(string text)
        Print(string format, params object[] args)
        Reflect(object obj)
        Reflect(object obj, string method_name)
    */
    #endregion

    private void RunScript(Plane x, ref object a)
    {
        a = x.IsValid ? x : null;
    }
}
# ---------- end c_script ----------
filter = StreamFilter(Gate=expression_4, Stream0=pce_3.Piece, Stream1=pce_4.Piece)
concat_5 = Concatenate(FragmentA=concat_2, FragmentB=" U ", FragmentC=concat)
concat_6 = Concatenate(FragmentA=concat_2, FragmentB=" \ ", FragmentC=concat)
concat_7 = Concatenate(FragmentA=concat_2, FragmentB=" \ ", FragmentC=concat)
trim_11 = TrimTree(Tree=c_script, Depth=1)
merge_3 = Merge(Data1=graft(con_3.Gap), Data2=graft(con_4.Gap))
merge_4 = Merge(Data1=graft(con_3.Shift), Data2=graft(con_4.Shift))
merge_5 = Merge(Data1=graft(con_3.Tilt), Data2=graft(expression_3))
merge_6 = Merge(Data1=graft(con_3.Rotation), Data2=graft(expression_2))
tstat = TreeStatistics(Tree=selcon_2)  # -> Paths, Length, Count
tstat_2 = TreeStatistics(Tree=selcon)  # -> Paths, Length, Count
pce_5 = ModelPiece(Piece=filter, Plane=trim_11)  # -> Piece, Valid, Id, TypeName, TypeVariant, Plane, DiagramPoint
trim_12 = TrimTree(Tree=tstat_2.Length, Depth=1)
trim_13 = TrimTree(Tree=tstat.Length, Depth=1)
concat_8 = Concatenate(FragmentA=t_2, FragmentB=",", FragmentC=expression)
interp = InterpolateData(Data=merge_6, Parameter=t_2, Interpolation=2)
interp_2 = InterpolateData(Data=merge_3, Parameter=t_2, Interpolation=2)
interp_3 = InterpolateData(Data=merge_4, Parameter=t_2, Interpolation=2)
interp_4 = InterpolateData(Data=merge_5, Parameter=t_2, Interpolation=2)
filter_2 = StreamFilter(Gate=expression_4, Stream0=con_3.Connection, Stream1=con_4.Connection)
pc_s_u_t = Piece(pce_5.Piece)
pc_t_s = Piece(trim_7)
pc_s_t = Piece(trim_10)
trim_14 = TrimTree(Tree=interp_3, Depth=1)
equals = Equality(FirstNumber=trim_13, SecondNumber="0")  # -> Equality, Inequality
trim_15 = TrimTree(Tree=interp, Depth=1)
trim_16 = TrimTree(Tree=interp_4, Depth=1)
equals_2 = Equality(FirstNumber=trim_12, SecondNumber="0")  # -> Equality, Inequality
trim_17 = TrimTree(Tree=interp_2, Depth=1)
con_5 = ModelConnection(Connection=filter_2, Rotation=trim_15, Tilt=trim_16, Gap=trim_17, Shift=trim_14)  # -> Connection, Valid, ConnectedPieceId, ConnectedPieceTypePortId, ConnectingPieceId, ConnectingPieceTypePortId, Rotation, Tilt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
cull = CullPattern(List=trim_2, CullPattern=equals_2.Equality)
cull_2 = CullPattern(List=trim_3, CullPattern=equals.Equality)
co_s_u_t = Connection(con_5.Connection)
co_s_t = Connection(cull)
co_t_s = Connection(cull_2)
dsn_5 = ModelDesign(Name=concat_6, Pieces=pc_s_t, Connections=co_s_t)  # -> Design, Valid, Name, Description, Icon, Image, Variant, View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
dsn_6 = ModelDesign(Name=concat_7, Pieces=pc_t_s, Connections=co_t_s)  # -> Design, Valid, Name, Description, Icon, Image, Variant, View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
dsn_7 = ModelDesign(Name=concat_5, Variant=concat_8, Pieces=pc_s_u_t, Connections=co_s_u_t)  # -> Design, Valid, Name, Description, Icon, Image, Variant, View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
dn_s_u_t = Design(dsn_7.Design)
dn_s_t = Design(dsn_5.Design)
dn_t_s = Design(dsn_6.Design)
dn_s_t_2 = ClusterOutput(dn_s_t)
dn_s_u_t_2 = ClusterOutput(dn_s_u_t)
dn_t_s_2 = ClusterOutput(dn_t_s)

# ==== cluster MergeDesigns: Merge a list of distinct designs into a new design. All designs are normalized first, so the connections align. All the pieces have the name and variant as a prefix to ensure uniqueness. Make sure every design is distinct by having a unique combination of name and variant.
dn = ClusterInput()
na = ClusterInput()
description = ClusterInput()
icon = ClusterInput()
image = ClusterInput()
variant = ClusterInput()
view = ClusterInput()
qualities = ClusterInput()
authors = ClusterInput()
dn_2 = Design(dn)
na_2 = Name(na)
description_2 = Description(description)
icon_2 = Icon(icon)
image_2 = Image(image)
variant_2 = Variant(variant)
view_2 = View(view)
qualities_2 = Qualities(qualities)
authors_2 = Authors(authors)
dsn = NormalizeDesign_2(dn=dn_2)
dsn_2 = ModelDesign(Design=dsn)  # -> Design, Valid, Name, Description, Icon, Image, Variant, View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
pce = ModelPiece(Piece=dsn_2.Pieces)  # -> Piece, Valid, Id, TypeName, TypeVariant, Plane, DiagramPoint
con = ModelConnection(Connection=dsn_2.Connections)  # -> Connection, Valid, ConnectedPieceId, ConnectedPieceTypePortId, ConnectingPieceId, ConnectingPieceTypePortId, Rotation, Tilt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
concat = Concatenate(FragmentA=dsn_2.Name, FragmentB=",", FragmentC=dsn_2.Variant, FragmentD=",", FragmentE=dsn_2.View)
concat_2 = Concatenate(FragmentC=graft(concat), FragmentA=",", FragmentB=pce.Id)
concat_3 = Concatenate(FragmentC=graft(concat), FragmentA=",", FragmentB=con.ConnectedPieceId)
concat_4 = Concatenate(FragmentC=graft(concat), FragmentA=",", FragmentB=con.ConnectingPieceId)
pce_2 = ModelPiece(Piece=pce.Piece, Id=concat_2)  # -> Piece, Valid, Id, TypeName, TypeVariant, Plane, DiagramPoint
con_2 = ModelConnection(Connection=con.Connection, ConnectedPieceId=concat_3, ConnectingPieceId=concat_4)  # -> Connection, Valid, ConnectedPieceId, ConnectedPieceTypePortId, ConnectingPieceId, ConnectingPieceTypePortId, Rotation, Tilt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
trim = TrimTree(Tree=con_2.Connection, Depth=1)
trim_2 = TrimTree(Tree=pce_2.Piece, Depth=1)
dsn_3 = ModelDesign(
    Name=na_2,
    Description=description_2,
    Icon=icon_2,
    Image=image_2,
    Variant=variant_2,
    View=view_2,
    Pieces=trim_2,
    Connections=trim,
    Qualities=qualities_2,
    Authors=authors_2)  # -> Design, Valid, Name, Description, Icon, Image, Variant, View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
dn_3 = Design(dsn_3.Design)
dn_4 = ClusterOutput(dn_3)

# ==== cluster PerformanceAssessment: Perform simple performance assement based on the following qualities of the types: (No unit conversion is applied for now, so make sure that all your types have the values with the same unit.) effective floor area construction cost maintenance expenses income heating energy demand cooling energy demand technical equipment energy demand construction global warming potential
dn = ClusterInput()
ty = ClusterInput()
heating_energy_price_cent_kwh = ClusterInput()
heating_efficiency_factor = ClusterInput()
heating_global_warming_potential_kgco2e = ClusterInput()  # "Heating Global Warming Potential [kgCO2e/kWh]"
cooling_energy_price_cent_kwh = ClusterInput()
cooling_efficiency_factor = ClusterInput()
cooling_global_warming_potential_kgco2e = ClusterInput()  # "Cooling Global Warming Potential [kgCO2e/kWh]"
electrictiy_energy_price_cent_kwh = ClusterInput()
electrictiy_global_warming_potential_kgc = ClusterInput()  # "Electrictiy Global Warming Potential [kgCO2e/kWh]"
dn_2 = Design(dn)
heating_energy_price_cent_kwh_2 = Number(heating_energy_price_cent_kwh)
heating_efficiency_factor_2 = Number(heating_efficiency_factor)
heating_global_warming_potential_kgco2e_2 = Number(heating_global_warming_potential_kgco2e)  # "Heating Global Warming Potential [kgCO2e/kWh]"
cooling_energy_price_cent_kwh_2 = Number(cooling_energy_price_cent_kwh)
cooling_efficiency_factor_2 = Number(cooling_efficiency_factor)
cooling_global_warming_potential_kgco2e_2 = Number(cooling_global_warming_potential_kgco2e)  # "Cooling Global Warming Potential [kgCO2e/kWh]"
electrictiy_energy_price_cent_kwh_2 = Number(electrictiy_energy_price_cent_kwh)
electrictiy_global_warming_potential_kgc_2 = Number(electrictiy_global_warming_potential_kgc)  # "Electrictiy Global Warming Potential [kgCO2e/kWh]"
ty_2 = Type(ty)
sumqal = SumQualities(dn=dn_2, ty=ty_2, na="heating energy demand")  # -> num_2, ql_2
sumqal_2 = SumQualities(dn=dn_2, ty=ty_2, na="cooling energy demand")  # -> num_2, ql_2
sumqal_3 = SumQualities(dn=dn_2, ty=ty_2, na="technical equipment energy demand")  # -> num_2, ql_2
sumqal_4 = SumQualities(dn=dn_2, ty=ty_2, na="income")  # -> num_2, ql_2
sumqal_5 = SumQualities(dn=dn_2, ty=ty_2, na="maintenance expenses")  # -> num_2, ql_2
sumqal_6 = SumQualities(dn=dn_2, ty=ty_2, na="construction cost")  # -> num_2, ql_2
sumqal_7 = SumQualities(dn=dn_2, ty=ty_2, na="effective floor area")  # -> num_2, ql_2
expression = Expression(x=sumqal.num_2, y=heating_efficiency_factor_2, Expression="x*(1/y)")
expression_2 = Expression(x=sumqal_2.num_2, y=cooling_efficiency_factor_2, Expression="x*(1/y)")
addition = Addition(A=expression, B=expression_2, C=sumqal_3.num_2)
multiplication = Multiplication(A=heating_energy_price_cent_kwh_2, B=expression)
multiplication_2 = Multiplication(A=heating_global_warming_potential_kgco2e_2, B=expression)
multiplication_3 = Multiplication(A=cooling_energy_price_cent_kwh_2, B=expression_2)
multiplication_4 = Multiplication(A=cooling_global_warming_potential_kgco2e_2, B=expression_2)
multiplication_5 = Multiplication(A=sumqal_3.num_2, B=electrictiy_energy_price_cent_kwh_2)
multiplication_6 = Multiplication(A=electrictiy_global_warming_potential_kgc_2, B=electrictiy_global_warming_potential_kgc_2)
sumqal_8 = SumQualities(dn=dn_2, ty=ty_2, na="construction global warming potential")  # -> num_2, ql_2
division = Division(A=addition, B=sumqal_7.num_2)
addition_2 = Addition(A=multiplication, B=multiplication_3, C=multiplication_5)
addition_3 = Addition(A=multiplication_2, B=multiplication_4, C=multiplication_6)
division_2 = Division(A=addition_3, B=sumqal_7.num_2)
addition_4 = Addition(A=sumqal_5.num_2, B=addition_2)
subtraction = Subtraction(A=sumqal_4.num_2, B=addition_4)
panel = Panel("""https://identifier.buildingsmart.org/uri/buildingsmart/ifc/4.3/prop/NetFloorArea
https://identifier.buildingsmart.org/uri/etim/etim/9.0/prop/EF016979


https://identifier.buildingsmart.org/uri/etim/etim/9.0/prop/EF016979

https://identifier.buildingsmart.org/uri/etim/etim/9.0/prop/EF016979


https://identifier.buildingsmart.org/uri/buildingsmart/ifc/4.3/prop/EnergyConsumption

https://identifier.buildingsmart.org/uri/buildingsmart/ifc/4.3/prop/EnergyConsumption
https://identifier.buildingsmart.org/uri/buildingsmart/ifc/4.3/prop/EnergyConsumption
https://identifier.buildingsmart.org/uri/buildingsmart/ifc/4.3/prop/EnergyConsumption""")
panel_2 = Panel("""effective floor area
specific operational global warming potential
construction cost
return
construction global warming potential
operational cost
operational global warming potential
income
maintenance expenses
specific energy demand
operational energy cost
heating energy demand
cooling energy demand
technical equipment energy demand""")
effective_floor_area_m² = Number(sumqal_7.num_2)
specific_operational_global_warming_pote = Number(division_2)  # "Specific Operational Global Warming Potential [kgCO2e/m²a]"
construction_cost = Number(sumqal_6.num_2)
return_a = Number(subtraction)
operational_cost_a = Number(addition_4)
maintenance_expenses_a = Number(sumqal_5.num_2)
specific_energy_demand_kwh_m²a = Number(division)
operational_energy_cost_a = Number(addition_2)
cooling_energy_demand_kwh_a = Number(sumqal_2.num_2)
construction_global_warming_potential_kg = Number(sumqal_8.num_2)  # "Construction Global Warming Potential [kgCO2e]"
operational_global_warming_potential_kgc = Number(addition_3)  # "Operational Global Warming Potential [kgCO2e/a]"
income = Number(sumqal_4.num_2)
heating_energy_demand_kwh_a = Number(sumqal.num_2)
technical_equipment_energy_demand_kwh_a = Number(sumqal_3.num_2)
merge = Merge(
    Data1=effective_floor_area_m²,
    Data2=specific_operational_global_warming_pote,
    Data3=construction_cost,
    Data4=return_a,
    Data5=construction_global_warming_potential_kg,
    Data6=operational_cost_a,
    Data7=operational_global_warming_potential_kgc,
    Data8=income,
    Data9=maintenance_expenses_a,
    Data10=specific_energy_demand_kwh_m²a,
    Data11=operational_energy_cost_a,
    Data12=heating_energy_demand_kwh_a,
    Data13=cooling_energy_demand_kwh_a,
    Data14=technical_equipment_energy_demand_kwh_a)
panel_3 = Panel("""m²
kgCO2e/m²a
€
€/a
kgCO2e
€/a
kgCO2e/a
€
€/a
kWh/m²a
€/a
kWh/a
kWh/a
kWh/a""")
dsn = ModelDesign(Design=dn_2)  # -> Design, Valid, Name, Description, Icon, Image, Variant, View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
trim = TrimTree(Tree=dsn.Qualities, Depth=1)
qal = ModelQuality(Name=panel_2, Value=merge, Unit=panel_3, Definition=panel)  # -> Quality, Valid, Name, Value, Unit, Definition
merge_2 = Merge(Data1=trim, Data2=qal.Quality)
dsn_2 = ModelDesign(Design=dsn.Design, Qualities=merge_2)  # -> Design, Valid, Name, Description, Icon, Image, Variant, View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
dn_3 = Design(dsn_2.Design)
effective_floor_area_m²_2 = ClusterOutput(effective_floor_area_m²)
specific_operational_global_warming_pote_2 = ClusterOutput(specific_operational_global_warming_pote)  # "Specific Operational Global Warming Potential [kgCO2e/m²a]"
construction_cost_2 = ClusterOutput(construction_cost)
return_a_2 = ClusterOutput(return_a)
construction_global_warming_potential_kg_2 = ClusterOutput(construction_global_warming_potential_kg)  # "Construction Global Warming Potential [kgCO2e]"
operational_cost_a_2 = ClusterOutput(operational_cost_a)
operational_global_warming_potential_kgc_2 = ClusterOutput(operational_global_warming_potential_kgc)  # "Operational Global Warming Potential [kgCO2e/a]"
income_2 = ClusterOutput(income)
maintenance_expenses_a_2 = ClusterOutput(maintenance_expenses_a)
specific_energy_demand_kwh_m²a_2 = ClusterOutput(specific_energy_demand_kwh_m²a)
operational_energy_cost_a_2 = ClusterOutput(operational_energy_cost_a)
heating_energy_demand_kwh_a_2 = ClusterOutput(heating_energy_demand_kwh_a)
cooling_energy_demand_kwh_a_2 = ClusterOutput(cooling_energy_demand_kwh_a)
technical_equipment_energy_demand_kwh_a_2 = ClusterOutput(technical_equipment_energy_demand_kwh_a)
dn_4 = ClusterOutput(dn_3)

# ==== cluster SelectDesign: Select a design with a name, an optional variant and an optional view. If no variant is provided it will select all variants. If you want to select the default variant then use the empty text. If no view is provided it will select all views. If you want to select the default view then use the empty text.
dn = ClusterInput()
na = ClusterInput()
variant = ClusterInput()
view = ClusterInput()
dn_2 = Design(dn)
na_2 = Name(na)
variant_2 = Variant(variant)
view_2 = View(view)
dsn = ModelDesign(Design=dn_2)  # -> Design, Valid, Name, Description, Icon, Image, Variant, View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
expression = Expression(x=dsn.Name, y=na_2, Expression="x=y")
cull = CullPattern(List=dsn.Design, CullPattern=expression)
dsn_2 = ModelDesign(Design=cull)  # -> Design, Valid, Name, Description, Icon, Image, Variant, View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
expression_2 = Expression(x=dsn_2.Variant, y=variant_2, Expression="x=y")
null = NullItem(Item=view_2)  # -> NullFlags, InvalidFlags, Description
cull_2 = CullPattern(List=cull, CullPattern=expression_2)
dsn_3 = ModelDesign(Design=cull_2)  # -> Design, Valid, Name, Description, Icon, Image, Variant, View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
expression_3 = Expression(x=dsn_3.View, y=view_2, Expression="x=y")
cull_3 = CullPattern(List=cull_2, CullPattern=expression_3)
filter = StreamFilter(Gate=null.NullFlags, Stream0=cull_3, Stream1=cull_2)
null_2 = NullItem(Item=variant_2)  # -> NullFlags, InvalidFlags, Description
filter_2 = StreamFilter(Gate=null_2.NullFlags, Stream0=filter, Stream1=cull)
dn_3 = Design(filter_2)
dn_4 = ClusterOutput(dn_3)

# ==== cluster MoveDesign: Move (translate and rotate) the design by moving all planes and centers.
dn = ClusterInput()
pn = ClusterInput()
ce = ClusterInput()
dn_2 = Design(dn)
pn_2 = Transform(pn)
ce_2 = Transform(ce)
dsn = ModelDesign(Design=dn_2)  # -> Design, Valid, Name, Description, Icon, Image, Variant, View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
trim = TrimTree(Tree=dsn.Pieces, Depth=1)
pce = ModelPiece(Piece=trim)  # -> Piece, Valid, Id, TypeName, TypeVariant, Plane, Center
pt = Point(pce.Center)
pt_2 = Point(ce_2)
transform = Transform(Geometry=pce.Plane, Transform=pn_2)
transform_2 = Transform(Geometry=pt, Transform=pt_2)
pce_2 = ModelPiece(Piece=pce.Piece, Plane=transform, Center=transform_2)  # -> Piece, Valid, Id, TypeName, TypeVariant, Plane, Center
dsn_2 = ModelDesign(Design=dsn.Design, Pieces=pce_2.Piece)  # -> Design, Valid, Name, Description, Icon, Image, Variant, View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
dn_3 = Design(dsn_2.Design)
dn_4 = ClusterOutput(dn_3)

# ==== cluster SelectRepresentation: Select a representation based on mime, lod and tags. The mime and lod must be equal and the tags must contain all the given tags.
rp = ClusterInput()
mm = ClusterInput()
lod = ClusterInput()
tags = ClusterInput()
rp_2 = Representation(rp)
mm_2 = Mime(mm)
lod_2 = Lod(lod)
tags_2 = Tags(tags)
rep = ModelRepresentation(Representation=rp_2)  # -> Representation, Valid, Url, Mime, Lod, Tags
expression = Expression(x=rep.Mime, y=mm_2, Expression="x=y")
cull = CullPattern(List=rep.Representation, CullPattern=expression)
rep_2 = ModelRepresentation(Representation=cull)  # -> Representation, Valid, Url, Mime, Lod, Tags
expression_2 = Expression(x=rep_2.Lod, y=lod_2, Expression="x=y")
cull_2 = CullPattern(List=rep_2.Representation, CullPattern=expression_2)
rep_3 = ModelRepresentation(Representation=cull_2)  # -> Representation, Valid, Url, Mime, Lod, Tags
trim = TrimTree(Tree=rep_3.Tags, Depth=1)
contains = Contains(L=trim, I=tags_2)  # -> R; inputs L: list, I: list
# ---------- contains: Python ----------
#Component Information
#--------------------------------------------------------------------------------------------
if ghenv.Component.RunCount<2:
    #General
    #--------------------------------------------------------------------------------------------
    __author__ = "Ueli Saluz"
    __version__ = "2023.02.04"
    
    ghenv.Component.Name = "Contains"
    ghenv.Component.NickName = "Contains"
    ghenv.Component.Description = "True if list contains one of the items."
    ghenv.Component.Message = "VER 1.0"
    ghenv.Component.Category = "Set"
    ghenv.Component.SubCategory = "List"
    
     #Inputs
    #--------------------------------------------------------------------------------------------
    inputIndex=0
    
    ghenv.Component.Params.Input[inputIndex].Name = "List"
    ghenv.Component.Params.Input[inputIndex].NickName = "L"
    ghenv.Component.Params.Input[inputIndex].Description = ""
    ghenv.Component.Params.Input[inputIndex].Optional = False
    inputIndex+=1
    
    ghenv.Component.Params.Input[inputIndex].Name = "Items"
    ghenv.Component.Params.Input[inputIndex].NickName = "I"
    ghenv.Component.Params.Input[inputIndex].Description = ""
    ghenv.Component.Params.Input[inputIndex].Optional = False
    inputIndex+=1
    
    #Outputs
    #--------------------------------------------------------------------------------------------
    outputIndex=0
    
    ghenv.Component.Params.Output[outputIndex].Name = "Contains"
    ghenv.Component.Params.Output[outputIndex].NickName = "R"
    ghenv.Component.Params.Output[outputIndex].Description = ""
    outputIndex+=1

R = False
for i in I:
    if i in L:
        R = True
# ---------- end contains ----------
ma = MassAddition(Input=contains)  # -> Result, PartialResults
lng = ListLength(List=contains)
equals = Equality(FirstNumber=ma.Result, SecondNumber=lng)  # -> Equality, Inequality
cull_3 = CullPattern(List=rep_3.Representation, CullPattern=equals.Equality)
rep_4 = ModelRepresentation(Representation=cull_3)  # -> Representation, Valid, Url, Mime, Lod, Tags
curdir = CSharpScript()  # -> D, S
# ---------- curdir: C# ----------
#region Usings
using System;
using System.Linq;
using System.Collections;
using System.Collections.Generic;
using System.Drawing;
using System.IO;

using Rhino;
using Rhino.Geometry;

using Grasshopper;
using Grasshopper.Kernel;
using Grasshopper.Kernel.Data;
using Grasshopper.Kernel.Types;
#endregion

public class Script_Instance : GH_ScriptInstance
{
    private void RunScript(ref object D, ref object S)
    {
        D = Path.GetDirectoryName(this.GrasshopperDocument.FilePath);
        S = Path.DirectorySeparatorChar;
    }
}
# ---------- end curdir ----------
rep_5 = ReplaceText(Text=rep_4.Url, Find="/", Replace=curdir.S, RecursiveReplace=False)
rp_3 = Representation(rep_4.Representation)
pa_ur = Text(rep_5)
ur = Url(rep_4.Url)
rp_4 = ClusterOutput(rp_3)
ur_2 = ClusterOutput(ur)
pa_ur_2 = ClusterOutput(pa_ur)

# ==== cluster SelectPiece: Select a piece with the id.
pc = ClusterInput()
id = ClusterInput()
pc_2 = Piece(pc)
id_2 = Id(id)
pce = ModelPiece(Piece=pc_2)  # -> Piece, Valid, Id, TypeName, TypeVariant, Plane, ScreenPoint
expression = Expression(x=pce.Id, y=id_2, Expression="x=y")
cull = CullPattern(List=pce.Piece, CullPattern=expression)
pc_3 = Piece(cull)
pc_4 = ClusterOutput(pc_3)

# ==== cluster SelectConnection: Select a connection with the connected id and the connected id. The connections are symetric, so if the conected is the connecting and vice versa it will still selct them.
co = ClusterInput()
cdpc = ClusterInput()
cgpc = ClusterInput()
co_2 = Connection(co)
cdpc_2 = ConnectedPieceId(cdpc)
cgpc_2 = ConnectingPieceId(cgpc)
con = ModelConnection(Connection=co_2)  # -> Connection, Valid, ConnectedPieceId, ConnectedPieceTypePortId, ConnectingPieceId, ConnectingPieceTypePortId, Rotation, Tilt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
expression = Expression(x=con.ConnectedPieceId, y=cdpc_2, Expression="x=y")
expression_2 = Expression(x=con.ConnectedPieceId, y=cgpc_2, Expression="x=y")
expression_3 = Expression(x=con.ConnectingPieceId, y=cgpc_2, Expression="x=y")
expression_4 = Expression(x=con.ConnectingPieceId, y=cdpc_2, Expression="x=y")
and = GateAnd(A=expression, B=expression_3)
and_2 = GateAnd(A=expression_2, B=expression_4)
or = GateOr(A=and, B=and_2)
cull = CullPattern(List=con.Connection, CullPattern=or)
co_3 = Connection(cull)
co_4 = ClusterOutput(co_3)

# ==== cluster NormalizeDesign: Normalize a design for this document. This includes changing the unit to the document unit and rescaling the affected values. Further it reoders pieces, connections and qualities. Connections might be swapped, so that the connected piece id is lexically first. The order of authors is not changed.
dn = ClusterInput()
dn_2 = Design(graft(dn))
dsn = ModelDesign()  # -> Design, Valid, Name, Description, Icon, Image, Variant, View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
dsn_2 = ModelDesign(Design=dn_2)  # -> Design, Valid, Name, Description, Icon, Image, Variant, View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
trim = TrimTree(Tree=dsn_2.Pieces, Depth=1)
trim_2 = TrimTree(Tree=dsn_2.Qualities, Depth=1)
trim_3 = TrimTree(Tree=dsn_2.Connections, Depth=1)
cnvunt = ConvertUnit(Value=1, FromUnit=dsn_2.Unit, ToUnit=dsn.Unit)
con = ModelConnection(Connection=trim_3)  # -> Connection, Valid, ConnectedPieceId, ConnectedPieceTypePortId, ConnectingPieceId, ConnectingPieceTypePortId, Rotation, Tilt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
multiplication = Multiplication(A=con.Gap, B=cnvunt)
multiplication_2 = Multiplication(A=con.Shift, B=cnvunt)
con_2 = ModelConnection(Connection=con.Connection, Gap=multiplication, Shift=multiplication_2)  # -> Connection, Valid, ConnectedPieceId, ConnectedPieceTypePortId, ConnectingPieceId, ConnectingPieceTypePortId, Rotation, Tilt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
merge = Merge(Data1=graft(con_2.ConnectedPieceId), Data2=graft(con_2.ConnectingPieceId))
tsort = SortText(Keys=merge, Culture=127)  # -> Keys, Values
trim_4 = TrimTree(Tree=tsort.Keys, Depth=1)
expression = Expression(x=merge, y=trim_4, Expression="x=y")
item = ListItem(List=expression, Index=0, Wrap=True)
trim_5 = TrimTree(Tree=item, Depth=1)
dispatch = Dispatch(List=con_2.Connection, DispatchPattern=trim_5)  # -> ListA, ListB
con_3 = ModelConnection(Connection=dispatch.ListB)  # -> Connection, Valid, ConnectedPieceId, ConnectedPieceTypePortId, ConnectingPieceId, ConnectingPieceTypePortId, Rotation, Tilt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
con_4 = ModelConnection(
    Connection=dispatch.ListB,
    ConnectedPieceId=con_3.ConnectingPieceId,
    ConnectedPieceTypePortId=con_3.ConnectingPieceTypePortId,
    ConnectingPieceId=con_3.ConnectedPieceId,
    ConnectingPieceTypePortId=con_3.ConnectedPieceTypePortId)  # -> Connection, Valid, ConnectedPieceId, ConnectedPieceTypePortId, ConnectingPieceId, ConnectingPieceTypePortId, Rotation, Tilt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
merge_2 = Merge(Data1=dispatch.ListA, Data2=con_4.Connection)
con_5 = ModelConnection(Connection=merge_2)  # -> Connection, Valid, ConnectedPieceId, ConnectedPieceTypePortId, ConnectingPieceId, ConnectingPieceTypePortId, Rotation, Tilt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
concat = Concatenate(FragmentA=con_5.ConnectedPieceId, FragmentC="##", FragmentB=con_5.ConnectingPieceId)
pce = ModelPiece(Piece=trim)  # -> Piece, Valid, Id, TypeName, TypeVariant, Plane, ScreenPoint
qal = ModelQuality(Quality=trim_2)  # -> Quality, Valid, Name, Value, Unit, Definition
tsort_2 = SortText(Keys=concat, Values=con_5.Connection, Culture=127)  # -> Keys, Values
tsort_3 = SortText(Keys=qal.Name, Values=qal.Quality, Culture=127)  # -> Keys, Values
tsort_4 = SortText(Keys=pce.Id, Values=pce.Piece, Culture=127)  # -> Keys, Values
trim_6 = TrimTree(Tree=tsort_2.Values, Depth=1)
trim_7 = TrimTree(Tree=tsort_3.Values, Depth=1)
trim_8 = TrimTree(Tree=tsort_4.Values, Depth=1)
dsn_3 = ModelDesign(Design=dsn_2.Design, Unit=dsn.Unit, Pieces=trim_8, Connections=trim_6, Qualities=trim_7)  # -> Design, Valid, Name, Description, Icon, Image, Variant, View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
trim_9 = TrimTree(Tree=dsn_3.Design, Depth=1)
dn_3 = Design(trim_9)
dn_4 = ClusterOutput(dn_3)

# ==== cluster NormalizeDesign_2: Normalize a design for this document. This includes changing the unit to the document unit and rescaling the affected values. Further it reoders pieces, connections and qualities. Connections might be swapped, so that the connected piece id is lexically first. The order of authors is not changed.
dn = ClusterInput()
dn_2 = Design(graft(dn))
dsn = ModelDesign()  # -> Design, Valid, Name, Description, Icon, Image, Variant, View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
dsn_2 = ModelDesign(Design=dn_2)  # -> Design, Valid, Name, Description, Icon, Image, Variant, View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
trim = TrimTree(Tree=dsn_2.Pieces, Depth=1)
trim_2 = TrimTree(Tree=dsn_2.Qualities, Depth=1)
trim_3 = TrimTree(Tree=dsn_2.Connections, Depth=1)
cnvunt = ConvertUnit(Value=1, FromUnit=dsn_2.Unit, ToUnit=dsn.Unit)
con = ModelConnection(Connection=trim_3)  # -> Connection, Valid, ConnectedPieceId, ConnectedPieceTypePortId, ConnectingPieceId, ConnectingPieceTypePortId, Rotation, Tilt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
multiplication = Multiplication(A=con.Gap, B=cnvunt)
multiplication_2 = Multiplication(A=con.Shift, B=cnvunt)
con_2 = ModelConnection(Connection=con.Connection, Gap=multiplication, Shift=multiplication_2)  # -> Connection, Valid, ConnectedPieceId, ConnectedPieceTypePortId, ConnectingPieceId, ConnectingPieceTypePortId, Rotation, Tilt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
merge = Merge(Data1=graft(con_2.ConnectedPieceId), Data2=graft(con_2.ConnectingPieceId))
tsort = SortText(Keys=merge, Culture=127)  # -> Keys, Values
trim_4 = TrimTree(Tree=tsort.Keys, Depth=1)
expression = Expression(x=merge, y=trim_4, Expression="x=y")
item = ListItem(List=expression, Index=0, Wrap=True)
trim_5 = TrimTree(Tree=item, Depth=1)
dispatch = Dispatch(List=con_2.Connection, DispatchPattern=trim_5)  # -> ListA, ListB
txt = Text(dispatch.ListB)
con_3 = ModelConnection(Connection=dispatch.ListB)  # -> Connection, Valid, ConnectedPieceId, ConnectedPieceTypePortId, ConnectingPieceId, ConnectingPieceTypePortId, Rotation, Tilt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
clean = CleanTree(RemoveNulls=True, RemoveInvalid=True, RemoveEmpty=invert(False), Tree=txt)
tstat = TreeStatistics(Tree=clean)  # -> Paths, Length, Count
con_4 = ModelConnection(
    Connection=dispatch.ListB,
    ConnectedPieceId=con_3.ConnectingPieceId,
    ConnectedPieceTypePortId=con_3.ConnectingPieceTypePortId,
    ConnectingPieceId=con_3.ConnectedPieceId,
    ConnectingPieceTypePortId=con_3.ConnectedPieceTypePortId)  # -> Connection, Valid, ConnectedPieceId, ConnectedPieceTypePortId, ConnectingPieceId, ConnectingPieceTypePortId, Rotation, Tilt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
branch = TreeBranch(Tree=con_4.Connection, Path=tstat.Paths, MaintainPaths=True)
merge_2 = Merge(Data1=dispatch.ListA, Data2=branch)
con_5 = ModelConnection(Connection=merge_2)  # -> Connection, Valid, ConnectedPieceId, ConnectedPieceTypePortId, ConnectingPieceId, ConnectingPieceTypePortId, Rotation, Tilt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
pce = ModelPiece(Piece=trim)  # -> Piece, Valid, Id, TypeName, TypeVariant, Plane, ScreenPoint
concat = Concatenate(FragmentA=con_5.ConnectedPieceId, FragmentC="##", FragmentB=con_5.ConnectingPieceId)
qal = ModelQuality(Quality=trim_2)  # -> Quality, Valid, Name, Value, Unit, Definition
tsort_2 = SortText(Keys=concat, Values=con_5.Connection, Culture=127)  # -> Keys, Values
tsort_3 = SortText(Keys=qal.Name, Values=qal.Quality, Culture=127)  # -> Keys, Values
tsort_4 = SortText(Keys=pce.Id, Values=pce.Piece, Culture=127)  # -> Keys, Values
trim_6 = TrimTree(Tree=tsort_2.Values, Depth=1)
trim_7 = TrimTree(Tree=tsort_3.Values, Depth=1)
trim_8 = TrimTree(Tree=tsort_4.Values, Depth=1)
dsn_3 = ModelDesign(Design=dsn_2.Design, Unit=dsn.Unit, Pieces=trim_8, Connections=trim_6, Qualities=trim_7)  # -> Design, Valid, Name, Description, Icon, Image, Variant, View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
trim_9 = TrimTree(Tree=dsn_3.Design, Depth=1)
dn_3 = Design(trim_9)
dn_4 = ClusterOutput(dn_3)

# ==== cluster SumQualities: Sum up the qualities of a type for each piece with this type in a design.
dn = ClusterInput()
ty = ClusterInput()
na = ClusterInput()
dn_2 = Design(dn)
ty_2 = Type(ty)
na_2 = Name(na)
dsn = ModelDesign(Design=dn_2)  # -> Design, Valid, Name, Description, Icon, Image, Variant, View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
typ = ModelType(Type=ty_2)  # -> Type, Valid, Name, Description, Icon, Image, Variant, Unit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
trim = TrimTree(Tree=dsn.Pieces, Depth=1)
qal = ModelQuality(Quality=typ.Qualities)  # -> Quality, Valid, Name, Value, Unit, Definition
pce = ModelPiece(Piece=trim)  # -> Piece, Valid, Id, TypeName, TypeVariant, Plane, DiagramPoint
expression = Expression(x=na_2, y=qal.Name, Expression="x=y")
expression_2 = Expression(x=graft(pce.TypeVariant), y=typ.Variant, Expression="x=y")
expression_3 = Expression(x=graft(pce.TypeName), y=typ.Name, Expression="x=y")
cull = CullPattern(List=typ.Qualities, CullPattern=expression)
and = GateAnd(A=expression_3, B=expression_2)
qal_2 = ModelQuality(Quality=cull)  # -> Quality, Valid, Name, flatten(Value), Unit, Definition
cull_2 = CullPattern(List=ty_2, CullPattern=and)
lng = ListLength(List=ty_2)
txt = Text(ty_2)
txt_2 = Text(cull_2)
series = Series(Start=0, Step=1, Count=lng)
expression_4 = Expression(x=txt_2, y=txt, Expression="x=y")
trim_2 = TrimTree(Tree=series, Depth=1)
cull_3 = CullPattern(List=trim_2, CullPattern=expression_4)
trim_3 = TrimTree(Tree=cull_3, Depth=1)
item = ListItem(List=qal_2.Value, Index=trim_3, Wrap=True)
clean = CleanTree(RemoveNulls=True, RemoveInvalid=True, RemoveEmpty=False, Tree=item)
ma = MassAddition(Input=clean)  # -> Result, PartialResults
num = Number(ma.Result)
ql = Quality(qal_2.Quality)
num_2 = ClusterOutput(num)
ql_2 = ClusterOutput(ql)
